# Grasshopper definition 9_ML_Inference.ghx (Grasshopper 1.0.8)
# plug-ins: Eddy3D

pedestrian_level = Panel("1.8")

# ---- group: Buildings
brep = Brep([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])

# ----
preview = CustomPreview(Geometry=brep, Material=ColourSwatch(SwatchColor=RGB(255, 255, 255)))

# ---- group: ONNX File
path = FilePath("C:\Users\ilker\Desktop\Conditional_Transformer\Pix2PixHD_Model\pix2pixhd_model.onnx")

# ----
Z = UnitZ(Factor=pedestrian_level)

# ---- group: TERRAIN
srf = Surface(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)

# ----
list = ValueList({"North": 0, "Northeast": 45, "East": 90, "Southeast": 135, "South": 180, "Southwest": 225, "West": 270, "Northwest": 315}, selected="North")
move = Move(Geometry=srf, Motion=Z)  # -> Geometry, Transform
brep2grid = BrepToGridPoints(Geometry=move.Geometry, Spacing="2", Run=True)  # -> Points, Status
windpredict = WindPredictor(
    Points=brep2grid.Points,
    Buildings=brep,
    ONNXPath=path,
    U_ref="5",
    Z_ref=10,
    Pedestrian_level=pedestrian_level,
    Wind_dir=list,
    GPU=True)  # -> X, Y, WindSpeed
gradient = Gradient(
    LowerLimit=0,
    UpperLimit=1,
    Parameter=windpredict.WindSpeed,
    stops=[0: RGB(48, 18, 59), 0.0294: RGB(56, 40, 112), 0.0588: RGB(63, 62, 156), 0.0882: RGB(68, 82, 193), 0.118: RGB(70, 102, 221), 0.147: RGB(71, 122, 241)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])
del = DelaunayMesh(Points=brep2grid.Points, Plane=PlaneXY(0, 0, 0))
mcol = MeshColours(Mesh=del, Colours=gradient)
